# Dynamo graph InfoDrainage canalisation variable.dyn (Dynamo 2.19.4.6671)
# packages: Civil3DToolkit 1.0.17

current = Autodesk.AutoCAD.DynamoNodes.Document.Current()
pipeNetworks = PipeNetworks(document=current)
getPipesStructures = Autodesk.Civil.DynamoNodes.PipeNetworks.PipeNetwork.GetPipesStructures(pipeNetwork=pipeNetworks)
number_slider = DoubleSlider(500, range=300..1000 step 100)
setSizeByInnerDimension = Autodesk.Civil.DynamoNodes.PipeNetworks.Pipe.SetSizeByInnerDimension(pipe=getPipesStructures.Pipes, innerDimension=number_slider)
name = Autodesk.Civil.DynamoNodes.PipeNetworks.PipeNetwork.Name(pipeNetwork=pipeNetworks)
watch = Watch(pipeNetworks)
